# Grasshopper definition algorithm.gh (Grasshopper 1.0.4)

lens = Geometry(<curve referenced from the Rhino model>)
end = EndPoints(Curve=lens)  # -> Start, End
lens_groove_point = Geometry(end.Start)
number = Number(1)
number_2 = Number(-1)
Z = UnitZ(Factor=number)
Z_2 = UnitZ(Factor=number_2)
move = Move(Geometry=lens_groove_point, Motion=Z_2)  # -> Geometry, Transform
move_2 = Move(Geometry=lens_groove_point, Motion=Z)  # -> Geometry, Transform
number_3 = Number(1)
number_4 = Number(1)
Y = UnitY(Factor=number_4)
Y_2 = UnitY(Factor=number_3)
move_3 = Move(Geometry=move_2.Geometry, Motion=Y)  # -> Geometry, Transform
move_4 = Move(Geometry=move.Geometry, Motion=Y_2)  # -> Geometry, Transform
lens_groove_point_2 = Geometry(move_4.Geometry)
lens_groove_point_3 = Geometry(move_3.Geometry)
polyline = PolyLine(Vertices=[lens_groove_point_2, lens_groove_point, lens_groove_point_3], Closed=False)
groove_line_for_lens = Geometry(polyline)
swp1 = Sweep1(Rail=lens, Sections=groove_line_for_lens, Miter=1)
